# Grasshopper definition points_in_curve.gh (Grasshopper 1.0.7)

pt = Point([Point(-12.53110767, 5.591411965, 0), Point(8.406945649, -9.636263174, 0)])
crv = Curve(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)
python = GhPythonScript(points=pt, curve=crv)  # -> out, A, B, C, message; inputs points: list of Point3d, curve: Curve
# ---------- python: Python ----------
"""
Inputs:
    points: Point list to test
    curve: Closed planar curve

Outputs:
    A: Points inside curve
    B: Points outside curve
    C: Points not on curve plane
    message: Status message
"""

import Rhino.Geometry as rg

# Grasshopper supplies these names from the component inputs at runtime.
points = globals()["points"]  # type: list[rg.Point3d]
curve = globals()["curve"]  # type: rg.Curve


inside_pts = []
outside_pts = []
invalid_pts = []

tol = 0.001

# Try getting plane from curve
success, plane = curve.TryGetPlane()

# Guard clause
if not success:
    A = inside_pts
    B = outside_pts
    C = invalid_pts
    message = "Input curve is not planar."
else:

    for pt in points:

        # Check if point is near curve plane
        if abs(plane.DistanceTo(pt)) > tol:
            invalid_pts.append(pt)
            continue

        result = curve.Contains(pt, plane, tol)

        if result == rg.PointContainment.Inside:
            inside_pts.append(pt)
        else:
            outside_pts.append(pt)

    A = inside_pts
    B = outside_pts
    C = invalid_pts

    message = (
        "Success.\n"
        "Inside: {}\n"
        "Outside: {}\n"
        "Off plane: {}"
    ).format(
        len(inside_pts),
        len(outside_pts),
        len(invalid_pts)
    )
# ---------- end python ----------
panel = Panel(python.B)
panel_2 = Panel(python.A)
panel_3 = Panel(python.C)
panel_4 = Panel(python.message)
